# Dynamo graph InsertIntoSqlite.dyn (Dynamo 1.3.0.875)

file_path = Filename("C:\Users\JRMerlan\Desktop\Temp\Test Projects\SQLite Example\DB\MechanicalDb.db")
boolean = BoolSelector(true)
string = StringInput("INSERT INTO ")
table_name = StringInput("MechDucts")
string_2 = StringInput(" (")
string_3 = StringInput("Height")
string_4 = StringInput(",")
string_5 = StringInput("Width")
column_name = StringInput("Length")
string_6 = StringInput(")")
string_7 = StringInput(" VALUES ")
select_model_element = DSModelElementSelection()  # 1 picked in the model
getParameterValueByName = Element.GetParameterValueByName(element=select_model_element, parameterName=string_3)
string_from_object = FromObject(getParameterValueByName)
getParameterValueByName_2 = Element.GetParameterValueByName(element=select_model_element, parameterName=string_5)
string_from_object_2 = FromObject(getParameterValueByName_2)
getParameterValueByName_3 = Element.GetParameterValueByName(element=select_model_element, parameterName=column_name)
string_from_object_3 = FromObject(getParameterValueByName_3)
string_8 = StringInput(";")
concat = String.Concat(string, table_name, string_2, string_3, string_4, string_5, string_4, column_name, string_6, string_7, string_2, string_from_object, string_4, string_from_object_2, string_4, string_from_object_3, string_6, string_8)
SQLite_Command = Database.Command.SQLite_Command(file_path, boolean, concat)
watch = Watch(concat)
